# Grasshopper definition voronoi_corridor.gh (Grasshopper 1.0.8)

R = Region({Plane=PlaneXY(142.3230128, 52.47345201, 0), Size=Domain2(u=-2068.383196..2068.383196, v=-1300.574282..1300.574282)})
box = CenterBox(Base=PlaneXY(0, 0, 0), X=1000, Y=1000, Z=1000)
pop2d = Populate2D(Region=R, Count=100, Seed=1)
pop3d = Populate3D(Region=box, Count=100, Seed=1)
sph = Sphere(Base=PlaneXY(0, 0, 0), Radius=1000)
popgeo = PopulateGeometry(Geometry=sph, Count=50, Seed=1)
voronoi³ = Voronoi3D(Points=popgeo)  # -> Cells, Boundary
debrep = DeconstructBrep(Brep=voronoi³.Cells)  # -> Faces, Edges, Vertices
srfsplit = SurfaceSplit(Surface=sph, Curves=flatten(debrep.Edges))
msplit = MeshSplit()
area = Area(Geometry=srfsplit)  # -> Area, Centroid
scale = Scale(Geometry=srfsplit, Center=area.Centroid, Factor=0.8)  # -> Geometry, Transform
edges = BrepEdges(Brep=simplify(scale.Geometry))  # -> Naked, Interior, NonManifold
join = JoinCurves(Curves=edges.Naked, Preserve=False)  # -> flatten(Curves)
srfsplit_2 = SurfaceSplit(Surface=sph, Curves=join)
item = ListItem(List=srfsplit_2, Index=0, Wrap=True)
split = SplitBrep(Brep=item, Cutter=srfsplit)
